# Grasshopper definition UDP test.gh (Grasshopper 1.0.7)
# plug-ins: gHowl

udp = UDPReceiver(Address="127.0.0.1", Port="5000", Pattern=0)  # -> Info, Data
panel = Panel(udp.Data)
split = TextSplit(Text=panel, Separators=",")
panel_2 = Panel(split)
item = ListItem(List=panel_2, Index=0, Wrap=True)  # -> Item, Item1, Item2, Item3, Item4
xy = XYPlane(Origin=Point(0, 0, 0))
subtraction = Subtraction(A=item.Item1, B=item.Item4)
pt = ConstructPoint(XCoordinate=item.Item3, YCoordinate=subtraction, ZCoordinate=0)
rectangle = Rectangle(Plane=xy, XSize=item.Item, YSize=item.Item1, Radius=0)  # -> Rectangle, Length
number_slider = Slider(40, range=0..100)
cir = Circle(Plane=pt, Radius=item.Item2)
division = Division(A=item.Item, B=item.Item1)
multiplication = Multiplication(A=division, B=number_slider)
sdivide = DivideSurface(Surface=rectangle.Rectangle, UCount=multiplication, VCount=number_slider)  # -> flatten(Points), Normals, Parameters
pull = PullPoint(Point=sdivide.Points, Geometry=cir, ClosestOnly=True)  # -> ClosestPoint, Distance
sort = SortList(Keys=pull.Distance)  # -> reverse(Keys), ValuesA
item_2 = ListItem(List=sort.Keys, Index=0, Wrap=True)
multiplication_2 = Multiplication(A=item_2, B=Slider(0.391, range=0..1))
min = Minimum(A=pull.Distance, B=multiplication_2)
item_3 = ListItem(List=sdivide.Points, Index=0, Wrap=True)  # -> Item, Item1
bnd = Bounds(Numbers=min)
dist = Distance(PointA=item_3.Item, PointB=item_3.Item1)
remap = RemapNumbers(Value=min, Source=bnd, Target=Domain(0, 1))  # -> Mapped, Clipped
graph = GraphMapper(remap.Mapped, x0=0, x1=1, y0=0, y1=1, container_name="Sine", Equation_px=[0, 0.2499628514], Equation_py=[0, 1])
division_2 = Division(A=dist, B="2")
multiplication_3 = Multiplication(A=division_2, B=Slider(0.1, range=0..1))
multiplication_4 = Multiplication(A=division_2, B=Slider(1, range=0..1))
dom = ConstructDomain(DomainStart=multiplication_3, DomainEnd=multiplication_4)
remap_2 = RemapNumbers(Value=graph, Source=Domain(0, 1), Target=dom)  # -> Mapped, Clipped
neg = Negative(Value=remap_2.Mapped)
dom_2 = ConstructDomain(DomainStart=neg, DomainEnd=remap_2.Mapped)
rectangle_2 = Rectangle(Plane=sdivide.Points, XSize=dom_2, YSize=dom_2, Radius=0)  # -> Rectangle, Length
preview = CustomPreview(Geometry=rectangle_2.Rectangle, Material=ColourSwatch(SwatchColor=RGB(255, 255, 255)))
